# Grasshopper definition GSX2JSON-tutorial.ghx (Grasshopper 1.0.8)

gsheets2api = Python3Script()  # -> out, cols, rows
# ---------- gsheets2api: Python ----------
"""Grasshopper Script"""
a = "Hello Python 3 in Grasshopper!"
print(a)

# Source: https://docs.google.com/spreadsheets/d/1H3kjJ-HJ3AvZKDr39ck7iKPAL7yumozkZIHQDZATCJQ

import requests
import pandas as pd
from Grasshopper import DataTree
from Grasshopper.Kernel.Data import GH_Path

url = "https://opensheet.elk.sh/1H3kjJ-HJ3AvZKDr39ck7iKPAL7yumozkZIHQDZATCJQ/1"
r = requests.get(url, timeout=5)
r.raise_for_status()

df = pd.DataFrame(r.json())

# DataFrame output
a = df

# Column names
cols = df.columns.tolist()

# Grasshopper-friendly table output (tree: one branch per row)
rows_tree = DataTree[object]()
for i, row in enumerate(df.itertuples(index=False, name=None)):
    p = GH_Path(i)
    for v in row:
        rows_tree.Add(v, p)
rows = rows_tree

# Optional: panel-friendly strings
rows_text = [" | ".join(map(str, row)) for row in df.itertuples(index=False, name=None)]
# ---------- end gsheets2api ----------
simplify = SimplifyTree(Tree=gsheets2api.rows, Front=False)
panel = Panel(gsheets2api.cols)
branch = TreeBranch(Tree=simplify, Path=Slider(0, range=0..10), MaintainPaths=True)
panel_2 = Panel(branch)
